# Dynamo graph script.dyn (Dynamo 2.3.0.5885)

boolean = BoolSelector(true)
code_block = CodeBlock { "message"; }
import_clr_import_msvcrt_clr = Python(IN[0]=boolean, IN[1]=code_block)  # "import clr import msvcrt clr.AddReference("RevitAPIUI") from Autodesk.Revit.UI import * button = TaskDialogCommonButtons.None result = TaskDialogResult.Ok if IN[0] == True: TaskDialog.Show('User Text',IN[1],button) result = IN[1] else: result = "Set run to true" OUT = result"
# ---------- import_clr_import_msvcrt_clr.python (18 lines) ----------
import clr
import msvcrt
import System

clr.AddReference("RevitAPIUI")
from  Autodesk.Revit.UI import *

button = TaskDialogCommonButtons.None
result = TaskDialogResult.Ok
if IN[0] == True:
	TaskDialog.Show('User Text',IN[1],button)
	result = IN[1]
else:
	result = "Set run to true"

raise Exception("Че каво брат?")
		
OUT = result
# ----------------------------------------
